# Grasshopper definition appt_test.gh (Grasshopper 1.0.7)
# Copyright: prslvtsv
# plug-ins: Pancake, Heteroptera

size_in_y_dir = Slider(11, range=0..20)
pt = Point([<point referenced from the Rhino model> x45])
crv = Curve([<curve referenced from the Rhino model> x55])
to_polyominos = ToPolyominos(pt_existing=pt, size_in_y_dir=size_in_y_dir, grid_cells=crv)  # -> ij_existing, cells_to_remove, size_xy
conda_location = Panel("C:\ProgramData\Anaconda3\")
solver_file = Panel("C:\Users\GUEST\Documents\CODE\aective\sectiondev\appartments_solver\gh_solver.py")
truebutton = TrueOnlyButton(LastSaveLocalization="neutral,N")
python = GhPythonScript(
    conda=conda_location,
    script=solver_file,
    board_size_XY=to_polyominos.size_xy,
    remove_cells=to_polyominos.cells_to_remove,
    run_solver=truebutton)  # -> out, board_cells, tiling_solution
# ---------- python: Python ----------
# -*- coding: utf-8 -*-
"""
@author: prslvtsv
"""
###############################################################
#import ghdev.devcon as dev
#reload(dev)
#
#dev.init_dev_tools(locals(),  config=dev_options, verbose=True)
###############################################################
import subprocess
from subprocess import call, check_output
import shlex

conda_activate = conda + "Scripts\\" + "Activate"
swtich_env = "conda activate exc43"
conda_info = "conda info"



run_script = "python {} {} {}".format(script, board_size_XY, remove_cells)
#print run_script
if run_solver:
    cmd = " && ".join([conda_activate, swtich_env, run_script])
    ret = check_output(cmd, shell=True)
    print ret.splitlines()[1]
    exec("board_cells = {}".format(ret.splitlines()[0])) 
    exec("tiling_solution = {}".format(ret.splitlines()[1])) 
#    print ret.splitlines()
# ---------- end python ----------
number_slider = Slider(3.306, range=0..10)
number_slider_2 = Slider(5, range=0..100)
to_remove = Panel(to_polyominos.cells_to_remove)
existing = Panel(to_polyominos.ij_existing)
to_remove_2 = Panel(to_polyominos.size_xy)
panel = Panel(python.out)

# ---- group: parse board
python_2 = GhPythonScript(cells=python.board_cells)  # -> out, x, y; inputs cells: list
# ---------- python_2: Python ----------
# -*- coding: utf-8 -*-
"""
@author: prslvtsv
"""
###############################################################
#import ghdev.devcon as dev
#reload(dev)
#
#dev.init_dev_tools(locals(),  config=dev_options, verbose=True)
###############################################################

x= []
y = []

srt = sorted(cells)
print srt
for c in srt:
    
    x.append(c[0])
    y.append(c[1])
# ---------- end python_2 ----------

# ---- group: parse tiling
python_3 = GhPythonScript(cells=python.tiling_solution)  # -> out, x, y
# ---------- python_3: Python ----------
# -*- coding: utf-8 -*-
"""
@author: prslvtsv
"""
###############################################################
#import ghdev.devcon as dev
#reload(dev)
#
#dev.init_dev_tools(locals(),  config=dev_options, verbose=True)
###############################################################

x= []
y = []

print cells
srt = sorted(cells)
print srt
for c in srt:
    
    x.append(c[0])
    y.append(c[1])
# ---------- end python_3 ----------

# ----
panel_2 = Panel(python.board_cells)
board = Board(index_x=python_2.x, index_y=python_2.y)  # -> cell_srf, cell_rect, cell_pt
tiling = Board(index_x=python_3.x, index_y=python_3.y)  # -> cell_srf, cell_rect, cell_pt
dom = ConstructDomain(DomainStart=Slider(0.157, range=0..1), DomainEnd=Slider(0.913, range=0..1))
runion = RegionUnion(Curves=tiling.cell_rect)
tstat = TreeStatistics(Tree=tiling.cell_srf)  # -> Paths, Length, Count
boundary = BoundarySurfaces(Edges=runion)
range = Range(Domain=dom, Steps=expr("x-1", tstat.Count))
pcshuffle = Shuffle(List=range, Seed=Slider(1, range=0..1), LastSaveLocalization="neutral,N")
extremums = MinMax(Number=pcshuffle)  # -> Minimum, Maximum
hsl = ColourHSL(Alpha=0.7, Hue=pcshuffle, Saturation=1, Luminance=Slider(0.247, range=0..1))
data = Data(graft(hsl))
preview = CustomPreview(Geometry=simplify(boundary), Material=simplify(data))

# ==== cluster ToPolyominos
grid_cells = ClusterInput()  # grid_cells
size_in_y_dir = ClusterInput()  # size in Y dir
pt_existing = ClusterInput()  # pt_existing
data = Data(grid_cells)
pcen = PolygonCenter(Polyline=data)  # -> CenterV, CenterE, CenterA
sort_pt = SortPoints(Points=pcen.CenterV)  # -> Points, Indices
data_2 = Data(size_in_y_dir)
data_3 = Data(pt_existing)
partition = PartitionList(List=sort_pt.Points, Size=data_2)
cir = Circle(Plane=data_3, Radius=0.3)
sort_pt_2 = SortPoints(Points=partition)  # -> Points, Indices
pdecon = Deconstruct(Point=sort_pt_2.Points)  # -> XComponent, YComponent, ZComponent
panel = Panel(sort_pt_2.Points)
sort = SortList(Keys=pdecon.YComponent, ValuesA=sort_pt_2.Points)  # -> Keys, ValuesA
flip = FlipMatrix(Data=sort.ValuesA)
ptcomposenum = ComposeGridNumber(Points=flatten(flip), RowNum=data_2)
incurve = PointInCurve(Point=graft(ptcomposenum), Curve=cir)  # -> Relationship, Point
ma = MassAddition(Input=incurve.Relationship)  # -> Result, PartialResults
viewer = ParamViewer(ptcomposenum)
trim = TrimTree(Tree=ma.Result, Depth=1)
bool = Boolean(ma.Result)
bool_2 = Boolean(trim)
not = GateNot(A=bool_2)
ptindices = ExtractGridIndices(Grid=ptcomposenum)  # -> I_Indices, J_Indices
branch = TreeBranch(Tree=ptcomposenum, Path=Slider(0, range=0..10), MaintainPaths=True)
cull = CullPattern(List=ptindices.I_Indices, CullPattern=bool_2)
cull_2 = CullPattern(List=ptindices.J_Indices, CullPattern=bool_2)
cull_3 = CullPattern(List=ptindices.J_Indices, CullPattern=not)
cull_4 = CullPattern(List=ptindices.I_Indices, CullPattern=not)
python = GhPythonScript(x=cull_2, y=cull)  # -> out, a
# ---------- python: Python ----------
# -*- coding: utf-8 -*-
"""
@author: prslvtsv
"""
a = "({}, {})".format(x, y)
# ---------- end python ----------
lng = ListLength(List=ptcomposenum)  # -> flatten(Length)
clean = CleanTree(RemoveNulls=True, RemoveInvalid=True, RemoveEmpty=True, Tree=cull_4)
clean_2 = CleanTree(RemoveNulls=True, RemoveInvalid=True, RemoveEmpty=True, Tree=cull_3)
python_2 = GhPythonScript(x=flatten(python.a))  # -> out, a; inputs x: list
# ---------- python_2: Python ----------
# -*- coding: utf-8 -*-
"""
@author: prslvtsv
"""
b = ", ".join(x)
a = "[" + b + "]"
# ---------- end python_2 ----------
item = ListItem(List=lng, Index=0, Wrap=True)
lng_2 = ListLength(List=lng)
python_3 = GhPythonScript(x=clean_2, y=clean)  # -> out, flatten(a)
# ---------- python_3: Python ----------
# -*- coding: utf-8 -*-
"""
@author: prslvtsv
"""
a = "{},{}".format(x, y)
# ---------- end python_3 ----------
python_4 = GhPythonScript(x=flatten(python_3.a))  # -> out, a; inputs x: list; same code as python_2
merge = Merge(Data1=item, Data2=lng_2)
python_5 = GhPythonScript(x=flatten(python_3.a))  # -> out, a; inputs x: list
# ---------- python_5: Python ----------
# -*- coding: utf-8 -*-
"""
@author: prslvtsv
"""
j = ":".join(x)
a = j
# ---------- end python_5 ----------
ij_existing = ClusterOutput(python_2.a)  # ij_existing
join = TextJoin(Text=merge, Join=",")
cells_to_remove = ClusterOutput(python_5.a)  # ij_remove
panel_2 = Panel(python_5.a)
size_xy = ClusterOutput(join)  # size_XY

# ==== cluster Board
index_y = ClusterInput()  # index Y
index_x = ClusterInput()  # index X
data = Data(Slider(1, range=0..1))
Y = Data(index_y)
X = Data(index_x)
multiplication = Multiplication(A=data, B=-0.5)
multiplication_2 = Multiplication(A=Y, B=data)
multiplication_3 = Multiplication(A=X, B=data)
X_2 = UnitX(Factor=multiplication)
Y_2 = UnitY(Factor=multiplication)
addition = Addition(A=X_2, B=Y_2)
pt = ConstructPoint(XCoordinate=multiplication_3, YCoordinate=multiplication_2, ZCoordinate=0)
move = Move(Geometry=pt, Motion=addition)  # -> Geometry, Transform
ptcompose = ComposeGrid(Points=pt, Row=X, Column=Y)  # disabled
rectangle = Rectangle(Plane=move.Geometry, XSize=data, YSize=data, Radius=0)  # -> Rectangle, Length
boundary = BoundarySurfaces(Edges=rectangle.Rectangle)
cell_srf = ClusterOutput(boundary)  # cell_srf
cell_rect = ClusterOutput(rectangle.Rectangle)  # cell_rect
cell_pt = ClusterOutput(pt)  # cell_pt
