# Grasshopper definition appt_test_2.gh (Grasshopper 1.0.7)
# Copyright: prslvtsv
# plug-ins: Pancake, Telepathy

run_solver = TrueOnlyButton(LastSaveLocalization="neutral,N")  # disabled
toggle = BooleanToggle(True)  # disabled
conda_location = Panel("C:\ProgramData\Anaconda3\")  # disabled
solver_file = Panel("C:\Users\GUEST\Documents\CODE\aective\sectiondev\appartments_solver\gh_solver.py")  # disabled
size_in_y_dir = Slider(3, range=0..20)
size_in_y_dir_2 = Slider(2, range=0..20)
size_in_y_dir_3 = Slider(3, range=0..20)
size_in_y_dir_4 = Slider(3, range=0..20)
size_in_y_dir_5 = Slider(3, range=0..20)
size_in_y_dir_6 = Slider(3, range=0..20)
size_in_y_dir_7 = Slider(11, range=0..20)
crv = Curve([<curve referenced from the Rhino model> x6])
pt = Point([<point referenced from the Rhino model> x6])
pt_2 = Point([<point referenced from the Rhino model> x3])
crv_2 = Curve([<curve referenced from the Rhino model> x3])
pt_3 = Point([<point referenced from the Rhino model> x2])
crv_3 = Curve([<curve referenced from the Rhino model> x2])
crv_4 = Curve([<curve referenced from the Rhino model> x5])
pt_4 = Point([<point referenced from the Rhino model> x5])
crv_5 = Curve([<curve referenced from the Rhino model> x4])
pt_5 = Point([<point referenced from the Rhino model> x4])
pt_6 = Point([<point referenced from the Rhino model> x6])
crv_6 = Curve([<curve referenced from the Rhino model> x6])
pt_7 = Point([<point referenced from the Rhino model> x27])
crv_7 = Curve([<curve referenced from the Rhino model> x55])
to_polyominos = ToPolyominos(pt_existing=pt, size_in_y_dir=size_in_y_dir, grid_cells=crv)  # -> ij_existing, cells_to_remove, size_xy
to_polyominos_2 = ToPolyominos(pt_existing=pt_2, size_in_y_dir=size_in_y_dir_3, grid_cells=crv_2)  # -> ij_existing, cells_to_remove, size_xy
to_polyominos_3 = ToPolyominos(pt_existing=pt_3, size_in_y_dir=size_in_y_dir_2, grid_cells=crv_3)  # -> ij_existing, cells_to_remove, size_xy
to_polyominos_4 = ToPolyominos(pt_existing=pt_4, size_in_y_dir=size_in_y_dir_4, grid_cells=crv_4)  # -> ij_existing, cells_to_remove, size_xy
to_polyominos_5 = ToPolyominos(pt_existing=pt_5, size_in_y_dir=size_in_y_dir_5, grid_cells=crv_5)  # -> ij_existing, cells_to_remove, size_xy
to_polyominos_6 = ToPolyominos(pt_existing=pt_6, size_in_y_dir=size_in_y_dir_6, grid_cells=crv_6)  # -> ij_existing, cells_to_remove, size_xy
to_polyominos_7 = ToPolyominos(pt_existing=pt_7, size_in_y_dir=size_in_y_dir_7, grid_cells=crv_7)  # -> ij_existing, cells_to_remove, size_xy

# ---- group: PARAMETERS
# C:\Windows\System32\WindowsPowerShell\v1.0\powershell.exe -ExecutionPolicy ByPass -NoExit -Command "& 'C:\ProgramData\Anaconda3\shell\condabin\conda-hook.ps1' ; conda activate 'C:\ProgramData\Anaconda3' "
panel = Panel("\"C:\\ProgramData\\Anaconda3\\shell\\condabin\\conda-hook.ps1; conda activate C:\\ProgramData\\Anaconda3\\envs\\exc43;\"")
solver_file_2 = Panel("C:\Users\GUEST\Documents\CODE\aective\sectiondev\appartments_solver\gh_solver.py")
solver_script = RemoteSender(solver_file_2)
conda_activate = RemoteSender(panel)
shell_executable = RemoteSender("C:\Windows\System32\WindowsPowerShell\v1.0\powershell.exe")

# ----
board_remove_cells = RemoteSender(to_polyominos_7.cells_to_remove)
board_size = RemoteSender(to_polyominos_7.size_xy)
to_remove = Panel(to_polyominos_7.ij_existing)
to_remove_2 = Panel(to_polyominos_7.size_xy)
merge = Merge(
    Data1=to_polyominos_3.ij_existing,
    Data2=to_polyominos_2.ij_existing,
    Data3=to_polyominos_5.ij_existing,
    Data4=to_polyominos_6.ij_existing,
    Data5=to_polyominos.ij_existing,
    Data6=to_polyominos_4.ij_existing)
python = GhPythonScript(x=merge)  # -> a; inputs x: list
# ---------- python: Python ----------
# -*- coding: utf-8 -*-
"""
@author: prslvtsv
"""
###############################################################
#import ghdev.devcon as dev
#reload(dev)
#
#dev.init_dev_tools(locals(),  config=dev_options, verbose=True)
###############################################################

a = "..".join(x)
# ---------- end python ----------
tileset = RemoteSender(python)
tileset_2 = RemoteReceiver(tileset)  # disabled

# ---- group: run tiling solver
python_2 = GhPythonScript(conda=conda_location, script=solver_file, tiling_set=tileset_2, run_solver=run_solver)  # -> out, board_cells, tiling_solution; disabled
# ---------- python_2: Python ----------
# -*- coding: utf-8 -*-
"""
@author: prslvtsv
"""
###############################################################
#import ghdev.devcon as dev
#reload(dev)
#
#dev.init_dev_tools(locals(),  config=dev_options, verbose=True)
###############################################################
import subprocess
from subprocess import call, check_output
import shlex

conda_activate = conda + "Scripts\\" + "Activate"
swtich_env = "conda activate exc43"
conda_info = "conda info"


#print tiling_set
run_script = "python {} {} {} {}".format(script, board_size_XY, remove_cells, tiling_set)
#print run_script
if run_solver:
    cmd = " && ".join([conda_activate, swtich_env, run_script])
    ret = check_output(cmd, shell=True)

    print ret.splitlines()[1]
    exec("board_cells = {}".format(ret.splitlines()[0])) 
    exec("tiling_solution = {}".format(ret.splitlines()[1]))
# ---------- end python_2 ----------

# ----
panel_2 = Panel(python_2.out)  # disabled

# ---- group: parse board
python_3 = GhPythonScript(cells=python_2.board_cells)  # -> out, x, y; inputs cells: list; disabled
# ---------- python_3: Python ----------
# -*- coding: utf-8 -*-
"""
@author: prslvtsv
"""
###############################################################
#import ghdev.devcon as dev
#reload(dev)
#
#dev.init_dev_tools(locals(),  config=dev_options, verbose=True)
###############################################################

x= []
y = []

srt = sorted(cells)
print srt
for c in srt:
    
    x.append(c[0])
    y.append(c[1])
# ---------- end python_3 ----------

# ---- group: parse tiling
python_4 = GhPythonScript(cells=python_2.tiling_solution)  # -> out, x, y; disabled
# ---------- python_4: Python ----------
# -*- coding: utf-8 -*-
"""
@author: prslvtsv
"""
###############################################################
#import ghdev.devcon as dev
#reload(dev)
#
#dev.init_dev_tools(locals(),  config=dev_options, verbose=True)
###############################################################

x= []
y = []

print cells
srt = sorted(cells)
print srt
for c in srt:
    
    x.append(c[0])
    y.append(c[1])
# ---------- end python_4 ----------

# ---- group: generate geometry
tiling = Tiling(index_x=python_4.x, index_y=python_4.y)  # -> cell_srf, cell_rect, cell_pt; disabled

tiling_2 = Tiling(index_x=python_3.x, index_y=python_3.y)  # -> cell_srf, cell_rect, cell_pt; disabled

# ---- group: custom display
display = Display(geo_to_viz=tiling.cell_rect)  # disabled

display_2 = Display(geo_to_viz=tiling_2.cell_rect)  # disabled

# ----
board_remove_cells_2 = RemoteReceiver(board_remove_cells)
shell_executable_2 = RemoteReceiver(shell_executable)
conda_activate_2 = RemoteReceiver(conda_activate)
solver_script_2 = RemoteReceiver(solver_script)
board_size_2 = RemoteReceiver(board_size)
tileset_3 = RemoteReceiver(tileset)
python_5 = GhPythonScript(solver=solver_script_2, board_size=board_size_2, board_remove=board_remove_cells_2, tile_set=tileset_3)  # -> out, cmd_str
# ---------- python_5: Python ----------
# -*- coding: utf-8 -*-
"""
@author: prslvtsv
"""
###############################################################
#import ghdev.devcon as dev
#reload(dev)
#
#dev.init_dev_tools(locals(),  config=dev_options, verbose=True)
###############################################################

cmd_str = "python {} {} {} {}".format(solver, board_size, board_remove, tile_set)
# ---------- end python_5 ----------
panel_3 = Panel(python_5.cmd_str)
python_6 = GhPythonScript(terminal=shell_executable_2, conda_activate=conda_activate_2, payload=python_5.cmd_str)  # -> out, result
# ---------- python_6: Python ----------
# -*- coding: utf-8 -*-
"""
@author: prslvtsv
"""
###############################################################
#import ghdev.devcon as dev
#reload(dev)
#
#dev.init_dev_tools(locals(),  config=dev_options, verbose=True)
###############################################################

import subprocess as sub


def execute_in_shell(cmd):
    
    process = sub.Popen(cmd, executable=terminal, stdin=sub.PIPE, stdout=sub.PIPE, stderr=sub.PIPE, shell=True)
    stdout, stderr = process.communicate()
    print stdout
    return stdout


cmd = "; ".join([conda_activate, payload])
result = execute_in_shell(cmd).split('\n')
# ---------- end python_6 ----------
python_7 = GhPythonScript(result_in=python_6.result)  # -> out, board, tiling; inputs result_in: list
# ---------- python_7: Python ----------
# -*- coding: utf-8 -*-
"""
@author: prslvtsv
"""
###############################################################
#import ghdev.devcon as dev
#reload(dev)
#
#dev.init_dev_tools(locals(),  config=dev_options, verbose=True)
###############################################################

print type(result_in[0])
exec("board = {}".format(result_in[0].strip())) 
exec("tiling = {}".format(result_in[1].strip())) 
#board = result_in[0]
#tiling = result_in[1]
# ---------- end python_7 ----------

panel_4 = Panel(python)

# ---- group: parse tiling
python_8 = GhPythonScript(cells=python_7.tiling)  # -> out, x, y; same code as python_4

# ---- group: generate geometry
tiling_3 = Tiling(index_x=python_8.x, index_y=python_8.y)  # -> cell_srf, cell_rect, cell_pt

# ---- group: custom display
display_3 = Display(geo_to_viz=tiling_3.cell_rect)

# ==== cluster ToPolyominos
grid_cells = ClusterInput()  # grid_cells
size_in_y_dir = ClusterInput()  # size in Y dir
pt_existing = ClusterInput()  # pt_existing
data = Data(grid_cells)
pcen = PolygonCenter(Polyline=data)  # -> CenterV, CenterE, CenterA
sort_pt = SortPoints(Points=pcen.CenterV)  # -> Points, Indices
data_2 = Data(size_in_y_dir)
data_3 = Data(pt_existing)
partition = PartitionList(List=sort_pt.Points, Size=data_2)
cir = Circle(Plane=data_3, Radius=0.3)
sort_pt_2 = SortPoints(Points=partition)  # -> Points, Indices
pdecon = Deconstruct(Point=sort_pt_2.Points)  # -> XComponent, YComponent, ZComponent
panel = Panel(sort_pt_2.Points)
sort = SortList(Keys=pdecon.YComponent, ValuesA=sort_pt_2.Points)  # -> Keys, ValuesA
flip = FlipMatrix(Data=sort.ValuesA)
ptcomposenum = ComposeGridNumber(Points=flatten(flip), RowNum=data_2)
incurve = PointInCurve(Point=graft(ptcomposenum), Curve=cir)  # -> Relationship, Point
ma = MassAddition(Input=incurve.Relationship)  # -> Result, PartialResults
viewer = ParamViewer(ptcomposenum)
trim = TrimTree(Tree=ma.Result, Depth=1)
bool = Boolean(ma.Result)
bool_2 = Boolean(trim)
not = GateNot(A=bool_2)
ptindices = ExtractGridIndices(Grid=ptcomposenum)  # -> I_Indices, J_Indices
branch = TreeBranch(Tree=ptcomposenum, Path=Slider(0, range=0..10), MaintainPaths=True)
cull = CullPattern(List=ptindices.I_Indices, CullPattern=bool_2)
cull_2 = CullPattern(List=ptindices.J_Indices, CullPattern=bool_2)
cull_3 = CullPattern(List=ptindices.J_Indices, CullPattern=not)
cull_4 = CullPattern(List=ptindices.I_Indices, CullPattern=not)
lng = ListLength(List=ptcomposenum)  # -> flatten(Length)
clean = CleanTree(RemoveNulls=True, RemoveInvalid=True, RemoveEmpty=True, Tree=cull_4)
clean_2 = CleanTree(RemoveNulls=True, RemoveInvalid=True, RemoveEmpty=True, Tree=cull_3)
python = GhPythonScript(x=cull_2, y=cull)  # -> out, a
# ---------- python: Python ----------
# -*- coding: utf-8 -*-
"""
@author: prslvtsv
"""
a = "{},{}".format(x, y)
# ---------- end python ----------
item = ListItem(List=lng, Index=0, Wrap=True)
lng_2 = ListLength(List=lng)
python_2 = GhPythonScript(x=clean_2, y=clean)  # -> out, flatten(a); same code as python
python_3 = GhPythonScript(x=flatten(python_2.a))  # -> out, a; inputs x: list
# ---------- python_3: Python ----------
# -*- coding: utf-8 -*-
"""
@author: prslvtsv
"""
b = ", ".join(x)
a = "[" + b + "]"
# ---------- end python_3 ----------
python_4 = GhPythonScript(x=flatten(python.a))  # -> out, a; inputs x: list
# ---------- python_4: Python ----------
# -*- coding: utf-8 -*-
"""
@author: prslvtsv
"""
b = ":".join(x)
a = b
# ---------- end python_4 ----------
merge = Merge(Data1=item, Data2=lng_2)
python_5 = GhPythonScript(x=flatten(python_2.a))  # -> out, a; inputs x: list
# ---------- python_5: Python ----------
# -*- coding: utf-8 -*-
"""
@author: prslvtsv
"""
j = ":".join(x)
a = j
# ---------- end python_5 ----------
join = TextJoin(Text=merge, Join=",")
ij_existing = ClusterOutput(python_4.a)  # ij_existing
cells_to_remove = ClusterOutput(python_5.a)  # ij_remove
panel_2 = Panel(python_5.a)
size_xy = ClusterOutput(join)  # size_XY

# ==== cluster Tiling
index_y = ClusterInput()  # index Y
index_x = ClusterInput()  # index X
data = Data(Slider(1, range=0..1))
Y = Data(index_y)
X = Data(index_x)
ghpython_script = GhPythonScript(x=X, c=data)  # -> a
# ---------- ghpython_script: Python ----------
# -*- coding: utf-8 -*-
"""
@author: prslvtsv
"""
###############################################################
#import ghdev.devcon as dev
#reload(dev)
#
#dev.init_dev_tools(locals(),  config=dev_options, verbose=True)
###############################################################


a = x*c
# ---------- end ghpython_script ----------
ghpython_script_2 = GhPythonScript(x=Y, c=data)  # -> a; same code as ghpython_script
ghpython_script_3 = GhPythonScript(x=X, c=data)  # -> a
# ---------- ghpython_script_3: Python ----------
# -*- coding: utf-8 -*-
"""
@author: prslvtsv
"""
###############################################################
#import ghdev.devcon as dev
#reload(dev)
#
#dev.init_dev_tools(locals(),  config=dev_options, verbose=True)
###############################################################


a = x*c + c
# ---------- end ghpython_script_3 ----------
ghpython_script_4 = GhPythonScript(x=Y, c=data)  # -> a; same code as ghpython_script_3
pt = ConstructPoint(XCoordinate=ghpython_script, YCoordinate=ghpython_script_2, ZCoordinate=0)
pt_2 = ConstructPoint(XCoordinate=ghpython_script_3, YCoordinate=ghpython_script_4, ZCoordinate=0)
rec_2pt = Rectangle2Pt(Plane=PlaneXY(0, 0, 0), PointA=pt, PointB=pt_2, Radius=0)  # -> Rectangle, Length
pcen = PolygonCenter(Polyline=rec_2pt.Rectangle)  # -> CenterV, CenterE, CenterA
boundary = BoundarySurfaces(Edges=rec_2pt.Rectangle)
cell_srf = ClusterOutput(boundary)  # cell_srf
cell_rect = ClusterOutput(rec_2pt.Rectangle)  # cell_rect
cell_pt = ClusterOutput(pcen.CenterV)  # cell_pt

# ==== cluster Display
geo_to_viz = ClusterInput()
data = Data(geo_to_viz)
color = Color(data_in=data)
runion = RegionUnion(Curves=data)
boundary = BoundarySurfaces(Edges=runion)
preview = CustomPreview(Geometry=simplify(boundary), Material=simplify(color))
addition = Addition(A=color, B=ColourSwatch(SwatchColor=RGB(74, 74, 74)))
previewlw = CustomPreviewLineweights(
    Geometry=simplify(runion),
    Shader=simplify(ColourSwatch(SwatchColor=RGBA(0, 0, 0, 212))),
    Thickness=Slider(2, range=0..10),
    Absolute=False)
previewlw_2 = CustomPreviewLineweights(Geometry=simplify(data), Shader=simplify(addition), Thickness=Slider(0, range=0..10), Absolute=False)
previewmat = CustomPreviewMaterials(Geometry=boundary, DiffuseColor=color, Transparency=Slider(0.625, range=0..1))
createhatch = CreateHatch(Bake=False, Curves=runion, HatchPatternName="Hatch1", HatchScale=0.8, HatchRotation=45)  # -> HatchGeometry, HatchObjects
number_slider = Slider(0.625, range=0..1)
preview_2 = CustomPreview(Geometry=simplify(createhatch.HatchGeometry), Material=simplify(color))

# ==== cluster Color
data_in = ClusterInput()  # data_in
dom = ConstructDomain(DomainStart=Slider(0.157, range=0..1), DomainEnd=Slider(0.773, range=0..1))
tstat = TreeStatistics(Tree=data_in)  # -> Paths, Length, Count
bbox = BoundingBox(Content=data_in, Plane=PlaneXY(0, 0, 0), UnionBox=True)  # -> Box, Box_2
extremums = MinMax(Number=tstat.Length)  # -> Minimum, Maximum
range = Range(Domain=dom, Steps=expr("x-1", tstat.Length))
dim = Dimensions(Surface=bbox.Box)  # -> UDimension, VDimension
area = Area(Geometry=bbox.Box)  # -> Area, Centroid
pcshuffle = Shuffle(List=range, Seed=Slider(1, range=0..1), LastSaveLocalization="neutral,N")
extremums_2 = MinMax(Number=flatten(dim.UDimension))  # -> Minimum, Maximum
wheel = ColourWheel(
    extremums_2.Maximum,
    ColourGrips_Style=10,
    ColourGrips_Grip=[5.52954442, 3.821325235, 1.989214472, 5.130807126],
    ColourGrips_Lum=[0.1, 1],
    ColourGrips_Range=[0.9554561313, 0.9554561313, 0.9554561313, 0.9554561313],
    ColourGrips_Sat=[0.2, 1])
addition = Addition(A=dim.UDimension, B=area.Area)
hsv = ColourHSV(Alpha=1, Hue=pcshuffle, Saturation=1, Value=1)
subtraction = Subtraction(A=dim.UDimension, B=extremums_2.Minimum)
hsl = ColourHSL(Alpha=0.7, Hue=pcshuffle, Saturation=1, Luminance=Slider(0.247, range=0..1))
data = Data(simplify(graft(hsv)))
data_2 = Data(graft(wheel))
item = ListItem(List=hsv, Index=subtraction, Wrap=True)  # -> simplify(Item)
panel = Panel(dim.UDimension)
addition_2 = Addition(A=data, B=item)
division = Division(A=addition_2, B=2)
panel_2 = Panel(division)
color_out = ClusterOutput(item)  # color_out
