# Grasshopper definition appt_test_3.gh (Grasshopper 1.0.7)
# Copyright: prslvtsv
# plug-ins: Pancake, Telepathy

run_solver = TrueOnlyButton(LastSaveLocalization="neutral,N")  # disabled
toggle = BooleanToggle(True)  # disabled
conda_location = Panel("C:\ProgramData\Anaconda3\")  # disabled
solver_file = Panel("C:\Users\GUEST\Documents\CODE\aective\sectiondev\appartments_solver\gh_solver.py")  # disabled

# ---- group: appartments templates
size_in_y_dir = Slider(3, range=0..20)
size_in_y_dir_2 = Slider(3, range=0..20)
size_in_y_dir_3 = Slider(2, range=0..20)
size_in_y_dir_4 = Slider(3, range=0..20)
size_in_y_dir_5 = Slider(3, range=0..20)
size_in_y_dir_6 = Slider(3, range=0..20)
pt = Point([Point(17.1981432, -1.935424239, 0), Point(17.1981432, -2.935424239, 0), Point(17.1981432, -3.935424239, 0), Point(18.1981432, -1.935424239, 0), Point(18.1981432, -2.935424239, 0), Point(18.1981432, -3.935424239, 0)])
crv = Curve([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])
crv_2 = Curve([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])
crv_3 = Curve([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])
pt_2 = Point([Point(2.84037865, -1.935424239, 0), Point(2.84037865, -2.935424239, 0), Point(2.84037865, -3.935424239, 0)])
pt_3 = Point([Point(0.8277938219, -1.935424239, 0), Point(0.8277938219, -2.935424239, 0)])
pt_4 = Point([Point(22.01632453, -2.935424239, 0), Point(22.01632453, -1.935424239, 0), Point(21.01632453, -3.935424239, 0), Point(21.01632453, -2.935424239, 0), Point(21.01632453, -1.935424239, 0)])
crv_4 = Curve([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])
pt_5 = Point([Point(5.744305924, -1.935424239, 0), Point(5.744305924, -2.935424239, 0), Point(5.744305924, -3.935424239, 0), Point(6.744305924, -1.935424239, 0)])
crv_5 = Curve([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])
pt_6 = Point([Point(12.60996252, -1.935424239, 0), Point(12.60996252, -2.935424239, 0), Point(12.60996252, -3.935424239, 0), Point(13.60996252, -1.935424239, 0), Point(14.60996252, -1.935424239, 0), Point(13.60996252, -2.935424239, 0)])
crv_6 = Curve([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])
to_polyominos = ToPolyominos(pt_existing=pt, size_in_y_dir=size_in_y_dir, grid_cells=crv)  # -> ij_existing, cells_to_remove, size_xy
to_polyominos_2 = ToPolyominos(pt_existing=pt_2, size_in_y_dir=size_in_y_dir_2, grid_cells=crv_2)  # -> ij_existing, cells_to_remove, size_xy
to_polyominos_3 = ToPolyominos(pt_existing=pt_3, size_in_y_dir=size_in_y_dir_3, grid_cells=crv_3)  # -> ij_existing, cells_to_remove, size_xy
to_polyominos_4 = ToPolyominos(pt_existing=pt_4, size_in_y_dir=size_in_y_dir_4, grid_cells=crv_4)  # -> ij_existing, cells_to_remove, size_xy
to_polyominos_5 = ToPolyominos(pt_existing=pt_5, size_in_y_dir=size_in_y_dir_5, grid_cells=crv_5)  # -> ij_existing, cells_to_remove, size_xy
to_polyominos_6 = ToPolyominos(pt_existing=pt_6, size_in_y_dir=size_in_y_dir_6, grid_cells=crv_6)  # -> ij_existing, cells_to_remove, size_xy

# ----
tileset = RemoteReceiver()  # disabled

# ---- group: run tiling solver
python = GhPythonScript(conda=conda_location, script=solver_file, tiling_set=tileset, run_solver=run_solver)  # -> out, board_cells, tiling_solution; disabled
# ---------- python: Python ----------
# -*- coding: utf-8 -*-
"""
@author: prslvtsv
"""
###############################################################
#import ghdev.devcon as dev
#reload(dev)
#
#dev.init_dev_tools(locals(),  config=dev_options, verbose=True)
###############################################################
import subprocess
from subprocess import call, check_output
import shlex

conda_activate = conda + "Scripts\\" + "Activate"
swtich_env = "conda activate exc43"
conda_info = "conda info"


#print tiling_set
run_script = "python {} {} {} {}".format(script, board_size_XY, remove_cells, tiling_set)
#print run_script
if run_solver:
    cmd = " && ".join([conda_activate, swtich_env, run_script])
    ret = check_output(cmd, shell=True)

    print ret.splitlines()[1]
    exec("board_cells = {}".format(ret.splitlines()[0])) 
    exec("tiling_solution = {}".format(ret.splitlines()[1]))
# ---------- end python ----------

# ----
panel = Panel(python.out)  # disabled
appt_23_p = RemoteSender(to_polyominos_4.ij_existing)
appt_23_o = RemoteSender(to_polyominos.ij_existing)
appt_12_i = RemoteSender(to_polyominos_3.ij_existing)
appt_13_i = RemoteSender(to_polyominos_2.ij_existing)
appt_23_j = RemoteSender(to_polyominos_5.ij_existing)
appt_33_j = RemoteSender(to_polyominos_6.ij_existing)

# ---- group: parse board
python_2 = GhPythonScript(cells=python.board_cells)  # -> out, x, y; inputs cells: list; disabled
# ---------- python_2: Python ----------
# -*- coding: utf-8 -*-
"""
@author: prslvtsv
"""
###############################################################
#import ghdev.devcon as dev
#reload(dev)
#
#dev.init_dev_tools(locals(),  config=dev_options, verbose=True)
###############################################################

x= []
y = []

srt = sorted(cells)
print srt
for c in srt:
    
    x.append(c[0])
    y.append(c[1])
# ---------- end python_2 ----------

# ----
panel_2 = Panel(to_polyominos_4.ij_existing)

# ---- group: parse tiling
python_3 = GhPythonScript(cells=python.tiling_solution)  # -> out, x, y; disabled
# ---------- python_3: Python ----------
# -*- coding: utf-8 -*-
"""
@author: prslvtsv
"""
###############################################################
#import ghdev.devcon as dev
#reload(dev)
#
#dev.init_dev_tools(locals(),  config=dev_options, verbose=True)
###############################################################

x= []
y = []

print cells
srt = sorted(cells)
print srt
for c in srt:
    
    x.append(c[0])
    y.append(c[1])
# ---------- end python_3 ----------

# ---- group: generate geometry
tiling = Tiling(index_x=python_3.x, index_y=python_3.y)  # -> cell_srf, cell_rect, cell_pt; disabled

tiling_2 = Tiling(index_x=python_2.x, index_y=python_2.y)  # -> cell_srf, cell_rect, cell_pt; disabled

# ----
merge = Merge(
    Data1=to_polyominos_3.ij_existing,
    Data2=to_polyominos_2.ij_existing,
    Data3=to_polyominos_5.ij_existing,
    Data4=to_polyominos_6.ij_existing,
    Data5=to_polyominos.ij_existing,
    Data6=to_polyominos_4.ij_existing)

# ---- group: custom display
display = Display(geo_to_viz=tiling.cell_rect)  # disabled

display_2 = Display(geo_to_viz=tiling_2.cell_rect)  # disabled

# ----
python_4 = GhPythonScript(x=merge)  # -> a; inputs x: list
# ---------- python_4: Python ----------
# -*- coding: utf-8 -*-
"""
@author: prslvtsv
"""
###############################################################
#import ghdev.devcon as dev
#reload(dev)
#
#dev.init_dev_tools(locals(),  config=dev_options, verbose=True)
###############################################################

a = "..".join(x)
# ---------- end python_4 ----------
tileset_all_apprt = RemoteSender(python_4)
panel_3 = Panel(python_4)

# ---- group: PARAMETERS
# C:\Windows\System32\WindowsPowerShell\v1.0\powershell.exe -ExecutionPolicy ByPass -NoExit -Command "& 'C:\ProgramData\Anaconda3\shell\condabin\conda-hook.ps1' ; conda activate 'C:\ProgramData\Anaconda3' "
panel_4 = Panel("\"C:\\ProgramData\\Anaconda3\\shell\\condabin\\conda-hook.ps1; conda activate C:\\ProgramData\\Anaconda3\\envs\\exc43;\"")
solver_file_2 = Panel("C:\Users\GUEST\Documents\CODE\aective\sectiondev\appartments_solver\gh_solver.py")
solver_file_3 = Panel("C:\Users\GUEST\Documents\CODE\aective\sectiondev\appartments_solver\gh_solver_conditional.py")
shell_executable = RemoteSender("C:\Windows\System32\WindowsPowerShell\v1.0\powershell.exe")
solver_conditional_script = RemoteSender(solver_file_3)
conda_activate = RemoteSender(panel_4)
solver_script = RemoteSender(solver_file_2)

# ---- group: floor_matrix
size_in_y_dir_7 = Slider(11, range=0..20)
crv_7 = Curve([<curve referenced from the Rhino model> x55])
pt_7 = Point([<point referenced from the Rhino model> x27])
to_polyominos_7 = ToPolyominos(pt_existing=pt_7, size_in_y_dir=size_in_y_dir_7, grid_cells=crv_7)  # -> ij_existing, cells_to_remove, size_xy
board_size = RemoteSender(to_polyominos_7.size_xy)
board_remove_cells = RemoteSender(to_polyominos_7.cells_to_remove)

# ---- group: appartments templates
appt_23_o_2 = RemoteReceiver(appt_23_o)
appt_23_p_2 = RemoteReceiver(appt_23_p)
appt_12_i_2 = RemoteReceiver(appt_12_i)
appt_13_i_2 = RemoteReceiver(appt_13_i)
appt_23_j_2 = RemoteReceiver(appt_23_j)
appt_33_j_2 = RemoteReceiver(appt_33_j)

# ----
ghpython_script = GhPythonScript(tiles=[appt_23_o_2, appt_23_j_2])  # -> formated; inputs tiles: list
# ---------- ghpython_script: Python ----------
# -*- coding: utf-8 -*-
"""
@author: prslvtsv
"""
###############################################################
#import ghdev.devcon as dev
#reload(dev)
#
#dev.init_dev_tools(locals(),  config=dev_options, verbose=True)
###############################################################

formated = "..".join(tiles)
# ---------- end ghpython_script ----------
ghpython_script_2 = GhPythonScript(tiles=[appt_12_i_2, appt_13_i_2])  # -> formated; inputs tiles: list; same code as ghpython_script
ghpython_script_3 = GhPythonScript(tiles=appt_13_i_2)  # -> formated; inputs tiles: list; same code as ghpython_script
python_5 = GhPythonScript(mandatory=ghpython_script, filler=ghpython_script_2)  # -> out, tileset
# ---------- python_5: Python ----------
# -*- coding: utf-8 -*-
"""
@author: prslvtsv
"""
###############################################################
#import ghdev.devcon as dev
#reload(dev)
#
#dev.init_dev_tools(locals(),  config=dev_options, verbose=True)
###############################################################

tileset = ""
if mandatory != None:
    tileset += "-m {} ".format(mandatory)
if optional != None:
    tileset += "-o {} ".format(optional)
if filler != None:
    tileset += "-f {} ".format(filler)
# ---------- end python_5 ----------
solver_conditional_script_2 = RemoteReceiver(solver_conditional_script)
board_remove_cells_2 = RemoteReceiver(board_remove_cells)
to_remove = Panel(to_polyominos_7.ij_existing)
shell_executable_2 = RemoteReceiver(shell_executable)
to_remove_2 = Panel(to_polyominos_7.size_xy)
conda_activate_2 = RemoteReceiver(conda_activate)
board_size_2 = RemoteReceiver(board_size)
python_6 = GhPythonScript(
    solver=solver_conditional_script_2,
    board_size=board_size_2,
    board_remove=board_remove_cells_2,
    tile_set=python_5.tileset)  # -> out, cmd_str
# ---------- python_6: Python ----------
# -*- coding: utf-8 -*-
"""
@author: prslvtsv
"""
###############################################################
#import ghdev.devcon as dev
#reload(dev)
#
#dev.init_dev_tools(locals(),  config=dev_options, verbose=True)
###############################################################

xs = board_size.split(",")[0]
ys = board_size.split(",")[1]

cmd_str = "python {} -s {} {} -r {} {}".format(solver, xs, ys, board_remove, tile_set)
# ---------- end python_6 ----------
panel_5 = Panel(python_6.cmd_str)
python_7 = GhPythonScript(terminal=shell_executable_2, conda_activate=conda_activate_2, payload=python_6.cmd_str)  # -> out, result
# ---------- python_7: Python ----------
# -*- coding: utf-8 -*-
"""
@author: prslvtsv
"""
###############################################################
#import ghdev.devcon as dev
#reload(dev)
#
#dev.init_dev_tools(locals(),  config=dev_options, verbose=True)
###############################################################

import subprocess as sub


def execute_in_shell(cmd):
    
    process = sub.Popen(cmd, executable=terminal, stdin=sub.PIPE, stdout=sub.PIPE, stderr=sub.PIPE, shell=True)
    stdout, stderr = process.communicate()
    print stdout
    return stdout


cmd = "; ".join([conda_activate, payload])
result = execute_in_shell(cmd).split('\n')
# ---------- end python_7 ----------
panel_6 = Panel(python_7.result)
python_8 = GhPythonScript(result_in=python_7.result)  # -> out, board, tiling; inputs result_in: list
# ---------- python_8: Python ----------
# -*- coding: utf-8 -*-
"""
@author: prslvtsv
"""
###############################################################
#import ghdev.devcon as dev
#reload(dev)
#
#dev.init_dev_tools(locals(),  config=dev_options, verbose=True)
###############################################################

print type(result_in[0])
exec("board = {}".format(result_in[0].strip())) 
exec("tiling = {}".format(result_in[1].strip())) 
#board = result_in[0]
#tiling = result_in[1]
# ---------- end python_8 ----------

# ---- group: parse tiling
python_9 = GhPythonScript(cells=python_8.tiling)  # -> out, x, y; same code as python_3

# ---- group: parse board
python_10 = GhPythonScript(cells=python_8.board)  # -> out, x, y; inputs cells: list; same code as python_2

# ---- group: generate geometry
tiling_3 = Tiling(index_x=python_9.x, index_y=python_9.y)  # -> cell_srf, cell_rect, cell_pt

# ----
bbox = BoundingBox(Content=flatten(tiling_3.cell_pt), Plane=PlaneXY(0, 0, 0), UnionBox=True)  # -> Box, Box_2

# ---- group: generate geometry
tiling_4 = Tiling(index_x=python_10.x, index_y=python_10.y)  # -> cell_srf, cell_rect, cell_pt

# ----
dim = Dimensions(Surface=bbox.Box)  # -> UDimension, VDimension
multiplication = Multiplication(A=dim.UDimension, B=2)
X = UnitX(Factor=multiplication)
move = Move(Geometry=tiling_3.cell_rect, Motion=X)  # -> Geometry, Transform

# ---- group: custom display
display_3 = Display(geo_to_viz=move.Geometry)

display_4 = Display(geo_to_viz=tiling_4.cell_rect)

# ----
board_remove_cells_3 = RemoteReceiver(board_remove_cells)  # disabled
shell_executable_3 = RemoteReceiver(shell_executable)  # disabled
tileset_all_apprt_2 = RemoteReceiver(tileset_all_apprt)  # disabled
conda_activate_3 = RemoteReceiver(conda_activate)  # disabled
solver_script_2 = RemoteReceiver(solver_script)  # disabled
board_size_3 = RemoteReceiver(board_size)  # disabled
python_11 = GhPythonScript(solver=solver_script_2, board_size=board_size_3, board_remove=board_remove_cells_3, tile_set=tileset_all_apprt_2)  # -> out, cmd_str; disabled
# ---------- python_11: Python ----------
# -*- coding: utf-8 -*-
"""
@author: prslvtsv
"""
###############################################################
#import ghdev.devcon as dev
#reload(dev)
#
#dev.init_dev_tools(locals(),  config=dev_options, verbose=True)
###############################################################

cmd_str = "python {} {} {} {}".format(solver, board_size, board_remove, tile_set)
# ---------- end python_11 ----------
python_12 = GhPythonScript(terminal=shell_executable_3, conda_activate=conda_activate_3, payload=python_11.cmd_str)  # -> out, result; disabled; same code as python_7
python_13 = GhPythonScript(result_in=python_12.result)  # -> out, board, tiling; inputs result_in: list; disabled; same code as python_8

ghpython_script_4 = GhPythonScript(x=python_11.cmd_str)  # -> a; disabled
# ---------- ghpython_script_4: Python ----------
# -*- coding: utf-8 -*-
"""
@author: prslvtsv
"""
###############################################################
#import ghdev.devcon as dev
#reload(dev)
#
#dev.init_dev_tools(locals(),  config=dev_options, verbose=True)
###############################################################
#a = "\n".join(x.split(" "))
a = x.split(" ")
# ---------- end ghpython_script_4 ----------

panel_7 = Panel(ghpython_script_4)  # disabled

# ---- group: parse tiling
python_14 = GhPythonScript(cells=python_13.tiling)  # -> out, x, y; disabled; same code as python_3

# ---- group: generate geometry
tiling_5 = Tiling(index_x=python_14.x, index_y=python_14.y)  # -> cell_srf, cell_rect, cell_pt; disabled

# ---- group: custom display
display_5 = Display(geo_to_viz=tiling_5.cell_rect)  # disabled

# ==== cluster ToPolyominos
grid_cells = ClusterInput()  # grid_cells
size_in_y_dir = ClusterInput()  # size in Y dir
pt_existing = ClusterInput()  # pt_existing
data = Data(grid_cells)
pcen = PolygonCenter(Polyline=data)  # -> CenterV, CenterE, CenterA
sort_pt = SortPoints(Points=pcen.CenterV)  # -> Points, Indices
data_2 = Data(size_in_y_dir)
data_3 = Data(pt_existing)
partition = PartitionList(List=sort_pt.Points, Size=data_2)
cir = Circle(Plane=data_3, Radius=0.3)
sort_pt_2 = SortPoints(Points=partition)  # -> Points, Indices
pdecon = Deconstruct(Point=sort_pt_2.Points)  # -> XComponent, YComponent, ZComponent
panel = Panel(sort_pt_2.Points)
sort = SortList(Keys=pdecon.YComponent, ValuesA=sort_pt_2.Points)  # -> Keys, ValuesA
flip = FlipMatrix(Data=sort.ValuesA)
ptcomposenum = ComposeGridNumber(Points=flatten(flip), RowNum=data_2)
incurve = PointInCurve(Point=graft(ptcomposenum), Curve=cir)  # -> Relationship, Point
ma = MassAddition(Input=incurve.Relationship)  # -> Result, PartialResults
viewer = ParamViewer(ptcomposenum)
trim = TrimTree(Tree=ma.Result, Depth=1)
bool = Boolean(ma.Result)
bool_2 = Boolean(trim)
not = GateNot(A=bool_2)
ptindices = ExtractGridIndices(Grid=ptcomposenum)  # -> I_Indices, J_Indices
branch = TreeBranch(Tree=ptcomposenum, Path=Slider(0, range=0..10), MaintainPaths=True)
cull = CullPattern(List=ptindices.I_Indices, CullPattern=bool_2)
cull_2 = CullPattern(List=ptindices.J_Indices, CullPattern=bool_2)
cull_3 = CullPattern(List=ptindices.J_Indices, CullPattern=not)
cull_4 = CullPattern(List=ptindices.I_Indices, CullPattern=not)
lng = ListLength(List=ptcomposenum)  # -> flatten(Length)
clean = CleanTree(RemoveNulls=True, RemoveInvalid=True, RemoveEmpty=True, Tree=cull_4)
clean_2 = CleanTree(RemoveNulls=True, RemoveInvalid=True, RemoveEmpty=True, Tree=cull_3)
python = GhPythonScript(x=cull_2, y=cull)  # -> out, a
# ---------- python: Python ----------
# -*- coding: utf-8 -*-
"""
@author: prslvtsv
"""
a = "{},{}".format(x, y)
# ---------- end python ----------
item = ListItem(List=lng, Index=0, Wrap=True)
lng_2 = ListLength(List=lng)
python_2 = GhPythonScript(x=clean_2, y=clean)  # -> out, flatten(a); same code as python
python_3 = GhPythonScript(x=flatten(python_2.a))  # -> out, a; inputs x: list
# ---------- python_3: Python ----------
# -*- coding: utf-8 -*-
"""
@author: prslvtsv
"""
b = ", ".join(x)
a = "[" + b + "]"
# ---------- end python_3 ----------
python_4 = GhPythonScript(x=flatten(python.a))  # -> out, a; inputs x: list
# ---------- python_4: Python ----------
# -*- coding: utf-8 -*-
"""
@author: prslvtsv
"""
b = ":".join(x)
a = b
# ---------- end python_4 ----------
merge = Merge(Data1=item, Data2=lng_2)
python_5 = GhPythonScript(x=flatten(python_2.a))  # -> out, a; inputs x: list
# ---------- python_5: Python ----------
# -*- coding: utf-8 -*-
"""
@author: prslvtsv
"""
j = ":".join(x)
a = j
# ---------- end python_5 ----------
join = TextJoin(Text=merge, Join=",")
ij_existing = ClusterOutput(python_4.a)  # ij_existing
cells_to_remove = ClusterOutput(python_5.a)  # ij_remove
panel_2 = Panel(python_5.a)
size_xy = ClusterOutput(join)  # size_XY

# ==== cluster Tiling
index_y = ClusterInput()  # index Y
index_x = ClusterInput()  # index X
data = Data(Slider(1, range=0..1))
Y = Data(index_y)
X = Data(index_x)
ghpython_script = GhPythonScript(x=X, c=data)  # -> a
# ---------- ghpython_script: Python ----------
# -*- coding: utf-8 -*-
"""
@author: prslvtsv
"""
###############################################################
#import ghdev.devcon as dev
#reload(dev)
#
#dev.init_dev_tools(locals(),  config=dev_options, verbose=True)
###############################################################


a = x*c
# ---------- end ghpython_script ----------
ghpython_script_2 = GhPythonScript(x=Y, c=data)  # -> a; same code as ghpython_script
ghpython_script_3 = GhPythonScript(x=X, c=data)  # -> a
# ---------- ghpython_script_3: Python ----------
# -*- coding: utf-8 -*-
"""
@author: prslvtsv
"""
###############################################################
#import ghdev.devcon as dev
#reload(dev)
#
#dev.init_dev_tools(locals(),  config=dev_options, verbose=True)
###############################################################


a = x*c + c
# ---------- end ghpython_script_3 ----------
ghpython_script_4 = GhPythonScript(x=Y, c=data)  # -> a; same code as ghpython_script_3
pt = ConstructPoint(XCoordinate=ghpython_script, YCoordinate=ghpython_script_2, ZCoordinate=0)
pt_2 = ConstructPoint(XCoordinate=ghpython_script_3, YCoordinate=ghpython_script_4, ZCoordinate=0)
rec_2pt = Rectangle2Pt(Plane=PlaneXY(0, 0, 0), PointA=pt, PointB=pt_2, Radius=0)  # -> Rectangle, Length
pcen = PolygonCenter(Polyline=rec_2pt.Rectangle)  # -> CenterV, CenterE, CenterA
boundary = BoundarySurfaces(Edges=rec_2pt.Rectangle)
cell_srf = ClusterOutput(boundary)  # cell_srf
cell_rect = ClusterOutput(rec_2pt.Rectangle)  # cell_rect
cell_pt = ClusterOutput(pcen.CenterV)  # cell_pt

# ==== cluster Display
geo_to_viz = ClusterInput()
data = Data(geo_to_viz)
color = Color(data_in=data)
runion = RegionUnion(Curves=data)
boundary = BoundarySurfaces(Edges=runion)
addition = Addition(A=color, B=ColourSwatch(SwatchColor=RGB(150, 150, 150)))
preview = CustomPreview(Geometry=simplify(boundary), Material=simplify(color))
previewlw = CustomPreviewLineweights(
    Geometry=simplify(runion),
    Shader=simplify(ColourSwatch(SwatchColor=RGBA(0, 0, 0, 212))),
    Thickness=Slider(2, range=0..10),
    Absolute=False)
previewlw_2 = CustomPreviewLineweights(Geometry=simplify(data), Shader=simplify(addition), Thickness=Slider(0, range=0..10), Absolute=False)
previewmat = CustomPreviewMaterials(Geometry=boundary, DiffuseColor=color, Transparency=Slider(0.197, range=0..1))
createhatch = CreateHatch(Bake=False, Curves=runion, HatchPatternName="Hatch1", HatchScale=0.8, HatchRotation=45)  # -> HatchGeometry, HatchObjects
number_slider = Slider(0.625, range=0..1)
preview_2 = CustomPreview(Geometry=simplify(createhatch.HatchGeometry), Material=simplify(color))

# ==== cluster Color
data_in = ClusterInput()  # data_in
dom = ConstructDomain(DomainStart=Slider(0.168, range=0..1), DomainEnd=Slider(0.922, range=0..1))
tstat = TreeStatistics(Tree=data_in)  # -> Paths, Length, Count
bbox = BoundingBox(Content=data_in, Plane=PlaneXY(0, 0, 0), UnionBox=True)  # -> Box, Box_2
extremums = MinMax(Number=tstat.Length)  # -> Minimum, Maximum
range = Range(Domain=dom, Steps=expr("x-1", tstat.Length))
dim = Dimensions(Surface=bbox.Box)  # -> UDimension, VDimension
area = Area(Geometry=bbox.Box)  # -> Area, Centroid
pcshuffle = Shuffle(List=range, Seed=Slider(1, range=0..1), LastSaveLocalization="neutral,N")
extremums_2 = MinMax(Number=flatten(dim.UDimension))  # -> Minimum, Maximum
wheel = ColourWheel(
    extremums_2.Maximum,
    ColourGrips_Style=10,
    ColourGrips_Grip=[5.115610268, 3.821325235, 1.989214472, 5.130807126],
    ColourGrips_Lum=[0.1, 1],
    ColourGrips_Range=[0.5123760279, 0.5123760279, 0.5123760279, 0.5123760279],
    ColourGrips_Sat=[0.2, 1])
addition = Addition(A=dim.UDimension, B=area.Area)
hsv = ColourHSV(Alpha=1, Hue=pcshuffle, Saturation=1, Value=1)
subtraction = Subtraction(A=dim.UDimension, B=extremums_2.Minimum)
hsl = ColourHSL(Alpha=0.7, Hue=pcshuffle, Saturation=1, Luminance=Slider(0.247, range=0..1))
data = Data(graft(wheel))
data_2 = Data(simplify(graft(hsv)))
item = ListItem(List=hsv, Index=subtraction, Wrap=True)  # -> simplify(Item)
panel = Panel(dim.UDimension)
addition_2 = Addition(A=data_2, B=item)
division = Division(A=addition_2, B=2)
panel_2 = Panel(division)
color_out = ClusterOutput(item)  # color_out
